# Dynamo custom node AddWorksets.dyf (Dynamo 1.2.1.3083)
# category: Sasaki
# Add standards worksets to central file and set their default visibility setting
# Input
#  "Activate": bool. Set to true to run the node
#    default value: "false"
#   optional: -
#  "AddWorksets": {{string,bool}, {string, bool}}. List of worksets to add to the central file and their corresponding default visibility setting. Example: {{WorksetName, true}, {WorksetName, false}}
#   default value: Embedded in the node (SA standard worsets)
#   optional: -
# Output
#  "NewWorksets": {string}. Worksets successfully added to the central file. The node will only add worksets that are not existing yet
#   optional: -

Activate = Input(Activate: bool = false)
AddWorksets = Input(AddWorksets: string[][] = null)
python_script = Python(IN[0]=Activate, IN[1]=AddWorksets)
# ---------- python_script.python (70 lines) ----------
import clr
clr.AddReference('RevitAPI')
from Autodesk.Revit.DB import *
import Autodesk

clr.AddReference("RevitNodes")
import Revit
clr.ImportExtensions(Revit.Elements)

clr.AddReference("RevitServices")
import RevitServices
from RevitServices.Persistence import DocumentManager
from RevitServices.Transactions import TransactionManager


###
activate = IN[0]
if IN[1] is None:
	add_worksets = [["Shared Levels and Grids", "True"],
				   ["Structure","True"],
				   ["Core and Vertical Circulation","True"],
				   ["Exterior Envelope","True"],
				   ["Interiors","True"],
				   ["RCP","True"],
				   ["Slabs","True"],
				   ["Furniture","False"],
				   ["Site","False"],
				   ["Rendering","False"],
				   ["Finishes","False"]]
			
else:
	add_worksets = IN[1]

###
existing_worksets = []
new_worksets = []

doc = DocumentManager.Instance.CurrentDBDocument

TransactionManager.Instance.EnsureInTransaction(doc)

if activate:
	coll = FilteredWorksetCollector(doc)
	coll.OfKind(WorksetKind.UserWorkset)
	
	for c in coll:
		existing_worksets.append(c.Name)
		
	for w in add_worksets:
		if not w[0] in existing_worksets:
			new_workset = Workset.Create(doc, w[0])
			
			if w[1] == "True":
				w[1] = True
			elif w[1] == "False":
				w[1] = False
			else:
				w[1] = False
				

			defaultVisibility = WorksetDefaultVisibilitySettings.GetWorksetDefaultVisibilitySettings(doc)
			defaultVisibility.SetWorksetVisibility(new_workset.Id, w[1])
			
			new_worksets.append(new_workset.Name)
		
TransactionManager.Instance.TransactionTaskDone()

###

OUT = new_worksets
# ----------------------------------------
NewWorksets = Output(python_script)
