# Dynamo custom node AssignDoorHardwareSet.dyf (Dynamo 1.3.0.875)
# category: Sasaki
# Assign the door hardware set in the Door Schedule from an Excel File

# group: OUTPUT
# note: SCRIPT OUTPUT MIGHT INCLUDE DATA OR SIMPLY NOTIFICATION OF WHETHER THE SCRIPT RAN SUCCESSFULLY. HIGHLIGHTING THE OUTPUT OR FINAL STEP WILL HELP OTHER USERS TO QUICKLY IDENTIFY WHERE TO LOOK FOR RESULTS
# note: SCRIPT OUTPUT

# group: PROCESS
# note: DYNAMO PROCESS ORGANIZED AND GROUPED IN STEPS SO THAT OTHER USERS CAN UNDERSTAND THE LOGIC OF THE SCRIPT IN ORDER TO CUSTOMIZE THE SCRIPT OR REUSE PORTION OF THE LOGIC TO IMPLEMENT NEW WORKFLOWS
# note: PROCESS DATA

# group: INPUT
# note: SCRIPT INPUT REQUIRED TO RUN THE SCRIPT. THESE INCLUDE INPUTS THAT ARE LESS LIKEY TO CHANGE FOR OTHER USERS TO IMPLEMENT THE SCRIPT ON THEIR PROJECT
# note: SECONDARY INPUT (OPTIONAL)

# group: INPUT
# note: PRIMARY INPUT REQUIRED TO RUN THE SCRIPT. THESE INCLUDES INPUTS THAT OTHER USERS NEED TO PROVIDE IN ORDER TO ADAPT THE WORKFLOW TO THEIR PROJECTS
# note: PRIMARY INPUT

# group: GENERAL
# note: CUSTOM NODE: AssignDoorHardwareSet
# DESCRIPTION: Assign Door Hardware Set in door schedule from an Excel File.
# REVIT VERSION 2017
# DYNAMO 1.3.0
# DEPENDENT PACKAGES: N/A
# AUTHOR: Ilaria Giardiello
# DATETIME: 06/05/2017
# LAST UPDATE: Ilaria Giardiello
# DATETIME: 02/09/2017
# REFERENCE: N/A

# group: INPUT
path = Input()
sheetName = Input(sheetName : string)
amount = Input(amount : int)
parameterName = Input(parameterName : string)

# group: READ EXCEL FILE
fromPath = FileObject(path)  # "File.FromPath"
boolean = BoolSelector(true)
readFromFile = Excel.ReadFromFile(file=fromPath, sheetName=sheetName, readAsStrings=boolean)

# group: CLEAN UP FILE FROM HEADERS AND EMPTY ROWS
dropItems = List.DropItems(list=readFromFile, amount=amount)
boolean_2 = BoolSelector(false)
clean = List.Clean(list=dropItems, preserveIndices=boolean_2)

# group: FILTER OUT EMPTY SETS IF ANY
PY_FilterOutEmptySets = Python(IN[0]=clean)
# ---------- PY_FilterOutEmptySets.python (31 lines) ----------
import clr
clr.AddReference('ProtoGeometry')
from Autodesk.DesignScript.Geometry import *
#The inputs to this node will be stored as a list in the IN variables.
dataEnteringNode = IN

list = UnwrapElement(IN[0])
ans = []

for l in list:
	if len(l) == 0:
		ans.append(False)
		
	elif len(l) <= 1:
		ans.append(False)
		
	else:
		TestList = []
		for x in l:
			if x == None:
				TestList.append(False)
			else:
				TestList.append(True)
		if any(t == False for t in TestList):
			ans.append(False)
		else:
			ans.append(True)
	

#Assign your output to the OUT variable.
OUT = ans
# ----------------------------------------
filterByBoolMask = List.FilterByBoolMask(list=clean, mask=PY_FilterOutEmptySets)

# group: DOOR MARKS AND HARDWARE SETS
in_ = Output(filterByBoolMask.in)  # "in"

# group: EMPTY SETS
out = Output(filterByBoolMask.out)

# group: SELECT ALL DOORS AND MATCH HARDWARE SET
categories = Categories("Doors")
all_elements_of_category = ElementsOfCategory(categories)
python_script = Python(IN[0]=all_elements_of_category, IN[1]=filterByBoolMask.in)
# ---------- python_script.python (22 lines) ----------
import clr
clr.AddReference('ProtoGeometry')
from Autodesk.DesignScript.Geometry import *
#The inputs to this node will be stored as a list in the IN variables.
dataEnteringNode = IN

import math

door_list = UnwrapElement(IN[0])
hardware_list = UnwrapElement(IN[1])
hardware_set = []
marks = []

for d in door_list:
	mark = d.LookupParameter("Mark").AsString()
	
	for i in range(len(hardware_list) - 1):
		if mark== hardware_list[i][0]:
			hardware_set.append([d, hardware_list[i][1], mark])
			

OUT = hardware_set
# ----------------------------------------
transpose = List.Transpose(python_script)
code_block = CodeBlock { 0; 1; }
getItemAtIndex = List.GetItemAtIndex(list=transpose, index=code_block.out0)
getItemAtIndex_2 = List.GetItemAtIndex(list=transpose, index=code_block.out1)
string_from_object = FromObject(getItemAtIndex_2)
string = StringInput(".")
split = String.Split(string_from_object, string)
transpose_2 = List.Transpose(split)
code_block_2 = CodeBlock(x=transpose_2) { x[0]; }

# group: SET HARDWARE SET PARAMETER TO EXCEL INFORMATION
setParameterByName = Element.SetParameterByName(element=getItemAtIndex, parameterName=parameterName, value=code_block_2)

# group: ASSIGNED HARDWARE SETS
Element = Output(setParameterByName)
