# Dynamo custom node CreateLevelsByElevation.dyf (Dynamo 1.2.1.3083)
# category: Sasaki
# Create levels by elevation

BaseElevation = Input()
NumberOfLevel = Input()
FloorToFloorHeight = Input()
sequence = Sequence(start=BaseElevation, amount=NumberOfLevel, step=FloorToFloorHeight, lacing=Longest)
string = StringInput("Level ")
BaseLevelNumber = Input()
sequence_2 = Sequence(start=BaseLevelNumber, amount=NumberOfLevel, lacing=Longest)
string_from_object = FromObject(sequence_2)
code_block = CodeBlock(a=string, b=string_from_object) { a+b; }
byElevationAndName = Level.ByElevationAndName(sequence, code_block)
Levels = Output(byElevationAndName)
