# Dynamo custom node CreatePlanViewFromLevel.dyf (Dynamo 1.3.0.875)
# category: Sasaki
# Automatically create Plan Views from selected levels, name them according to BPM standards, apply the selected view template and apply a scope box for view crop

# group: OUTPUT
# note: SCRIPT OUTPUT
# note: SCRIPT OUTPUT MIGHT INCLUDE DATA OR SIMPLY NOTIFICATION OF WHETHER THE SCRIPT RAN SUCCESSFULLY. HIGHLIGHTING THE OUTPUT OR FINAL STEP WILL HELP OTHER USERS TO QUICKLY IDENTIFY WHERE TO LOOK FOR RESULTS

# group: PROCESS
# note: PROCESS DATA
# note: DYNAMO PROCESS ORGANIZED AND GROUPED IN STEPS SO THAT OTHER USERS CAN UNDERSTAND THE LOGIC OF THE SCRIPT IN ORDER TO CUSTOMIZE THE SCRIPT OR REUSE PORTION OF THE LOGIC TO IMPLEMENT NEW WORKFLOWS

# group: INPUT
# note: SECONDARY INPUT (OPTIONAL)
# note: SCRIPT INPUT REQUIRED TO RUN THE SCRIPT. THESE INCLUDE INPUTS THAT ARE LESS LIKEY TO CHANGE FOR OTHER USERS TO IMPLEMENT THE SCRIPT ON THEIR PROJECT

# group: INPUT
# note: PRIMARY INPUT
# note: PRIMARY INPUT REQUIRED TO RUN THE SCRIPT. THESE INCLUDES INPUTS THAT OTHER USERS NEED TO PROVIDE IN ORDER TO ADAPT THE WORKFLOW TO THEIR PROJECTS

# group: GENERAL
# note: CUSTOM NODE: CreatePlanViewsFromLevels
# DESCRIPTION: Automatically create Plan Views from selected levels, name them according to BPM standards, apply the selected view template and apply a scope box for view crop
# REVIT VERSION 2017
# DYNAMO 1.3.0
# DEPENDENT PACKAGES: STEAMNODES, CLOCKWORK
# AUTHOR: Ilaria Giardiello
# DATETIME: 11/27/2017
# REFERENCE: N/A

# group: INPUT
LevelsName = Input()
IsWorkingView = Input(IsWorkingView : bool)
ViewPrefix = Input(ViewPrefix : string)
SelectViewTemplate = Input(SelectViewTemplate : string)
ScopeBox = Input(ScopeBox : string)

# group: EXTRACT SELECTED LEVELS
categories = Categories("Levels")
all_elements_of_category = ElementsOfCategory(categories)
filterSortLevelByName = Python(IN[0]=all_elements_of_category, IN[1]=LevelsName)
# ---------- filterSortLevelByName.python (28 lines) ----------
import clr
clr.AddReference('RevitAPI')
from Autodesk.Revit.DB import *

clr.AddReference("RevitNodes")
import Revit
clr.ImportExtensions(Revit.Elements)

clr.AddReference("RevitServices")
import RevitServices
from RevitServices.Persistence import DocumentManager
from RevitServices.Transactions import TransactionManager

doc = DocumentManager.Instance.CurrentDBDocument

levels = IN[0]
level_names = IN[1]
ans = []

for level in levels:
	if level is None:
		continue
	if level.Name in level_names:
		ans.append(level)
		
ans = sorted(ans, key=lambda x: level_names.index(x.Name))

OUT = ans
# ----------------------------------------
watch = Watch(filterSortLevelByName)

# group: CREATE PLAN VIEW BY LEVEL
byLevel = FloorPlanView.ByLevel(filterSortLevelByName)
watch_2 = Watch(byLevel)

# group: FORMAT VIEW NAME (BPM)
name = Element.Name(filterSortLevelByName)
python_script = Python(IN[0]=IsWorkingView, IN[1]=ViewPrefix, IN[2]=name)
# ---------- python_script.python (23 lines) ----------
import sys
sys.path.append("C:\Program Files (x86)\IronPython 2.7\Lib")

IsViewWorking = IN[0]
ViewPrefix = IN[1]
Levels = IN[2]

view_names = []

for level in Levels:
	if IsViewWorking == True:
		ViewPrefix = ViewPrefix.title()
		level = level.title()
		view_names.append("Working " + ViewPrefix + " - " + level)
	else:
		ViewPrefix = ViewPrefix.upper()
		level = level.upper()
		view_names.append(ViewPrefix + " - " + level)




OUT = view_names
# ----------------------------------------

# group: SET VIEW NAME
code_block = CodeBlock { "View Name"; }
setParameterByName = Element.SetParameterByName(element=byLevel, parameterName=code_block, value=python_script)

# group: VIEW NAMES
ViewName = Output(setParameterByName)

# group: EXTRACT ASSOCIATED LEVEL
code_block_2 = CodeBlock { "Associated Level"; }
getParameterValueByName = Element.GetParameterValueByName(element=byLevel, parameterName=code_block_2)

# group: APPLY VIEW TEMPLATE
# note: SteamNodes
applyViewTemplate = Custom[View.ApplyViewTemplate](Views=byLevel, View_Template_Name=SelectViewTemplate)  # Applies a view template to any given view(s). Supply a string with a view template name.

# group: SET SCOPE BOX
string = StringInput("Scope Box")
string_2 = StringInput("OST_VolumeOfInterest")
byName = Category.ByName(string_2)
all_elements_of_category_2 = ElementsOfCategory(byName)
filterByName = Custom[Elements.FilterByName](elements=all_elements_of_category_2, searchString=ScopeBox)  # Retrieves those elements from a collection whose names match the search string
setParameterByName_2 = Element.SetParameterByName(element=byLevel, parameterName=string, value=filterByName.first)
