# Dynamo custom node CreateSheetsFromExcel.dyf (Dynamo 1.3.0.875)
# category: Sasaki
# Automatically add Revit Sheets from Excel

# group: OUTPUT
# note: SCRIPT OUTPUT MIGHT INCLUDE DATA OR SIMPLY NOTIFICATION OF WHETHER THE SCRIPT RAN SUCCESSFULLY. HIGHLIGHTING THE OUTPUT OR FINAL STEP WILL HELP OTHER USERS TO QUICKLY IDENTIFY WHERE TO LOOK FOR RESULTS
# note: SCRIPT OUTPUT

# group: PROCESS
# note: DYNAMO PROCESS ORGANIZED AND GROUPED IN STEPS SO THAT OTHER USERS CAN UNDERSTAND THE LOGIC OF THE SCRIPT IN ORDER TO CUSTOMIZE THE SCRIPT OR REUSE PORTION OF THE LOGIC TO IMPLEMENT NEW WORKFLOWS
# note: PROCESS DATA

# group: INPUT
# note: SCRIPT INPUT REQUIRED TO RUN THE SCRIPT. THESE INCLUDE INPUTS THAT ARE LESS LIKEY TO CHANGE FOR OTHER USERS TO IMPLEMENT THE SCRIPT ON THEIR PROJECT
# note: SECONDARY INPUT (OPTIONAL)

# group: INPUT
# note: PRIMARY INPUT REQUIRED TO RUN THE SCRIPT. THESE INCLUDES INPUTS THAT OTHER USERS NEED TO PROVIDE IN ORDER TO ADAPT THE WORKFLOW TO THEIR PROJECTS
# note: PRIMARY INPUT

# group: GENERAL
# note: CUSTOM NODE: CreateSheetsFromExcel
# DESCRIPTION: Automatically add Revit Sheets from Excel
# REVIT VERSION 2017
# DYNAMO 1.3.0
# DEPENDENT PACKAGES: NONE
# AUTHOR: Ilaria Giardiello
# DATETIME: 04/15/2016
# REFERENCE: Original script written by James Warne & Matthew Anderle - AECOM

# group: INPUT
CreateUncreatedSheets = Input()

# group: INPUT
ExcelFilePath = Input()
ExcelSheetName = Input(ExcelSheetName : string)
TitleBlockFamilyType = Input(TitleBlockFamilyType : FamilyType)

# group: READ DATA FROM EXCEL FILE
fromPath = FileObject(ExcelFilePath)  # "File.FromPath"
readFromFile = Excel.ReadFromFile(file=fromPath, sheetName=ExcelSheetName)
transpose = List.Transpose(readFromFile)

# group: READ SHEET NUMBERS AND NAMES
code_block = CodeBlock { SHEET_NUMBER = 0; SHEET_NAME = 1; }
getItemAtIndex = List.GetItemAtIndex(list=transpose, index=code_block.SHEET_NAME)
watch = Watch(getItemAtIndex)
getItemAtIndex_2 = List.GetItemAtIndex(list=transpose, index=code_block.SHEET_NUMBER)
watch_2 = Watch(getItemAtIndex_2)

# group: FILTER OUT EXISTING SHEETS
categories = Categories("Sheets")
all_elements_of_category = ElementsOfCategory(categories)
sheetNumber = Sheet.SheetNumber(all_elements_of_category)
containsItem = List.ContainsItem(list=sheetNumber, item=watch_2)
list_filterbyboolmask_remove = List.FilterByBoolMask(list=watch, mask=containsItem)  # "List.FilterByBoolMask - Remove Sheet Names"
code_block_2 = CodeBlock { ""; }
if_ = If(test=CreateUncreatedSheets, true=list_filterbyboolmask_remove.out, false=code_block_2)
list_filterbyboolmask_remove_2 = List.FilterByBoolMask(list=watch_2, mask=containsItem)  # "List.FilterByBoolMask - Remove Sheet Numbers"

string_name_of_view_to_be_placed = StringInput("None")  # "String - Name of View to be Placed on Sheets (Not Used)"

# group: CREATE SHEETS
draftingview_byname_process_view = DraftingView.ByName(string_name_of_view_to_be_placed)  # "DraftingView.ByName - Process view as drafting view"
byNameNumberTitleBlockAndViews = Sheet.ByNameNumberTitleBlockAndViews(if_, list_filterbyboolmask_remove_2.out, TitleBlockFamilyType, draftingview_byname_process_view)

# group: CREATED SHEETS
Sheet = Output(byNameNumberTitleBlockAndViews)
