# Dynamo custom node MarkDoorByRoom.dyf (Dynamo 1.2.1.3083)
# category: Sasaki
# Mark Door by Room Number

Doors = Input()
location = Custom[Element.Location](element=Doors)  # Returns the location of an element as an XYZ (or if it's line-based the start and end point of the line), along with some booleans to help filtering the results. Use this for some element types (e.g. walls or lines) that do not work with the built-in Get Family Instance Location node.
filterByBoolMask = List.FilterByBoolMask(list=Doors, mask=location.hasLocation)
RoomSource = Input()
version = Custom[Application.Version]()  # Retrieves the name, version and build of the current Revit application.
python_script = Python(IN[0]=filterByBoolMask.in, IN[1]=RoomSource, IN[2]=version.Version_int)
# ---------- python_script.python (86 lines) ----------
#Copyright(c) 2015, Konrad Sobon
#@arch_laboratory, http://archi-lab.net

import clr
# Import RevitAPI
clr.AddReference("RevitAPI")
import Autodesk
from Autodesk.Revit.DB import *

# Import DocumentManager and TransactionManager
clr.AddReference("RevitServices")
import RevitServices
from RevitServices.Persistence import DocumentManager
from RevitServices.Transactions import TransactionManager

# Import ToDSType(bool) extension method
clr.AddReference("RevitNodes")
import Revit
clr.ImportExtensions(Revit.Elements)
 
# Start Transaction
doc = DocumentManager.Instance.CurrentDBDocument

fam_inst = IN[0]
direction = IN[1]
revitVersion = IN[2]

elements = []
for i in IN[0]:
	elements.append(UnwrapElement(i))

def TryGetToRoom(room, phase):
	try:
		toRoom = room.get_ToRoom(phase)
	except:
		toRoom = None
		pass
	return toRoom

def TryGetFromRoom(room, phase):
	try:
		fromRoom = room.get_FromRoom(phase)
	except:
		fromRoom = None
		pass
	return fromRoom

room_number, room_name, doors, room, ignored = [], [], [], [], []
for i in elements:
	for phase in doc.Phases:
		if i.CreatedPhaseId == phase.Id:
			for phase2 in doc.Phases:
				if TryGetToRoom(i, phase2) != None:
					to_room = TryGetToRoom(i, phase2)
					break
				else:
					to_room = None
			for phase3 in doc.Phases:
				if TryGetFromRoom(i, phase3) != None:
					from_room = TryGetFromRoom(i, phase3)
					break
				else:
					from_room = None
			if direction == "to" and to_room != None:
				if revitVersion == "2016":
					room_number.append(to_room.LookupParameter("Number").AsString())
					room_name.append(to_room.LookupParameter("Name").AsString())
				else:
					room_number.append(to_room.get_Parameter("Number").AsString())
					room_name.append(to_room.get_Parameter("Name").AsString())
				doors.append(i)
				room.append(to_room)
			elif direction == "from" and from_room != None:
				if revitVersion == "2016":
					room_number.append(from_room.LookupParameter("Number").AsString())
					room_name.append(from_room.LookupParameter("Name").AsString())
				else:
					room_number.append(from_room.get_Parameter("Number").AsString())
					room_name.append(from_room.get_Parameter("Name").AsString())
				doors.append(i)
				room.append(from_room)
			else:
				ignored.append(i)
					
#Assign your output to the OUT variable
OUT = room_number, room_name, doors, room, ignored
# ----------------------------------------
code_block = CodeBlock(IN=python_script) { roomNumber = IN[0]; RoomName = IN[1]; Doors = IN[2]; Rooms = IN[3]; Ignored = IN[4]; }
location_2 = Custom[Element.Location](element=code_block.Rooms)
XAxis = Vector.XAxis()
YAxis = Vector.YAxis()
byOriginVectors = CoordinateSystem.ByOriginVectors(origin=location_2.points, xAxis=XAxis, yAxis=YAxis)
YAxis_2 = CoordinateSystem.YAxis(byOriginVectors)
transform_origin = Custom[Transform Origin](Element=code_block.Doors)  # This node will query an element for an origin point of its geometry tranform property.
location_3 = FamilyInstance.Location(code_block.Doors)
isNull = Object.IsNull(location_3)
combine_by_pattern = Custom[Combine by Pattern](Pattern=transform_origin, True=location_3, False=isNull)  # Combines two list based on a input pattern of true and false.
byTwoPoints = Vector.ByTwoPoints(start=location_2.points, end=combine_by_pattern)
normalized = Vector.Normalized(byTwoPoints)
angleWithVector = Vector.AngleWithVector(vector=YAxis_2, otherVector=normalized)
xyz_components = CodeBlock(p=location_2.points) { p.X; p.Y; }
xyz_components_2 = CodeBlock(p=combine_by_pattern) { p.X; p.Y; }
python_script_2 = Python(IN[0]=angleWithVector, IN[1]=xyz_components.out0, IN[2]=xyz_components.out1, IN[3]=xyz_components_2.out0, IN[4]=xyz_components_2.out1)
# ---------- python_script_2.python (36 lines) ----------
#Copyright(c) 2015, Konrad Sobon
#@arch_laboratory, http://archi-lab.net

# Default imports
import clr
clr.AddReference('RevitAPI')
clr.AddReference('RevitAPIUI')
from Autodesk.Revit.DB import *
import clr
clr.AddReference('ProtoGeometry')
from Autodesk.DesignScript.Geometry import *

#The input to this node will be stored in the IN[0]...INX variable(s).
dataEnteringNode = IN[0]
import math

repAngle = IN[0]
roomX = IN[1]
roomY = IN[2]
doorX = IN[3]
doorY = IN[4]

result = []
for a, rx, ry, dx, dy in zip(repAngle, roomX, roomY, doorX, doorY):
	if dx >= rx  and dy >= ry:
		angle = a
	elif dx >= rx and dy <= ry:
		angle = 180 - a
	elif dx <= rx and dy <= ry:
		angle = 180 + a
	elif dx <= rx and dy >= ry:
		angle = 360 - a
	result.append(angle)

#Assign your output to the OUT variable
OUT = result
# ----------------------------------------
python_script_3 = Python(IN[0]=code_block.roomNumber, IN[1]=python_script_2, IN[2]=code_block.Doors)
# ---------- python_script_3.python (35 lines) ----------
#Copyright(c) 2015, Konrad Sobon
#@arch_laboratory, http://archi-lab.net

# Default imports
import clr
clr.AddReference('RevitAPI')
clr.AddReference('RevitAPIUI')
from Autodesk.Revit.DB import *
import clr
clr.AddReference('ProtoGeometry')
from Autodesk.DesignScript.Geometry import *

#The input to this node will be stored in the IN[0]...INX variable(s).
dataEnteringNode = IN[0]


from itertools import groupby

room_number = IN[0]
angle = IN[1]
door = IN[2]

grps = sorted(zip(room_number, angle, door), key=lambda x: (x[0], x[1]))
room_number, angle, door = [], [] ,[]
for i, grp in groupby(grps, lambda x: x[0]):
	sub_rm_number, sub_angle, sub_door = [], [] ,[]
	for j in grp:
		sub_rm_number.append(j[0])
		sub_angle.append(j[1])
		sub_door.append(j[2])
	room_number.extend(sub_rm_number)
	angle.extend(sub_angle)
	door.extend(sub_door)

OUT = room_number ,angle, door
# ----------------------------------------
code_block_2 = CodeBlock(IN=python_script_3) { Number = IN[0]; Angle = IN[1]; Doors = IN[2]; }
string = StringInput("Mark")
LetterRequired = Input()
python_script_4 = Python(IN[0]=code_block_2.Number, IN[1]=LetterRequired)
# ---------- python_script_4.python (55 lines) ----------
#Copyright(c) 2015, Konrad Sobon
#@arch_laboratory, http://archi-lab.net

# Default imports
import clr
clr.AddReference('RevitAPI')
clr.AddReference('RevitAPIUI')
from Autodesk.Revit.DB import *
import clr
clr.AddReference('ProtoGeometry')
from Autodesk.DesignScript.Geometry import *
from itertools import groupby

#The input to this node will be stored in the IN[0] variable.
dataEnteringNode = IN[0]
letterRequired = IN[1]

sequence = IN[0]
uniq_seq = []

def increment_item(item = 'A'):
    next_char = [ord(char) for char in item]
    next_char[-1] += 1
    for index in xrange(len(next_char)-1, -1, -1):
            if next_char[index] > ord('Z'):
                    next_char[index] = ord('A')
                    if index > 0:
                            next_char[index-1] += 1
                    else:
                            next_char.append(ord('A'))
    return ''.join((chr(char) for char in next_char))

def char_generator(start = 'A'):
    current = start
    yield start
    while True:
        current = increment_item(current)
        yield current

def build_unique_sequence(sequence):
    key_set = dict([item, char_generator()] for item in set(sequence))
    return map(lambda item:'{}{}'.format(item, key_set[item].next()), sequence)
    
def simplify_sequence(letter_sequence, sequence):
	freq = dict([(r, len(list(grp))) for r, grp in groupby(sorted(sequence))])
	for i, item in enumerate(letter_sequence):
		if freq[item[:-1]] != None and freq[item[:-1]] == 1:
			letter_sequence[i] = item[:-1]
	return letter_sequence

letter_sequence = build_unique_sequence(sequence)
if letterRequired:
	OUT = letter_sequence
else:
	OUT = simplify_sequence(letter_sequence, sequence)
# ----------------------------------------
setParameterByName = Element.SetParameterByName(element=code_block_2.Doors, parameterName=string, value=python_script_4)
DoorsNewMarks = Output(python_script_4)
DoorsWithoutSourceRoom = Output(code_block.Ignored)
DoorsRemarked = Output(code_block.Doors)
DoorsWithoutLocation = Output(filterByBoolMask.out)
