# Dynamo custom node MeasureMultipleLinesLength.dyf (Dynamo 1.3.0.875)
# category: Sasaki
# Display in a message box the total length of selected lines.

# group: OUTPUT
# note: SCRIPT OUTPUT MIGHT INCLUDE DATA OR SIMPLY NOTIFICATION OF WHETHER THE SCRIPT RAN SUCCESSFULLY. HIGHLIGHTING THE OUTPUT OR FINAL STEP WILL HELP OTHER USERS TO QUICKLY IDENTIFY WHERE TO LOOK FOR RESULTS
# note: SCRIPT OUTPUT

# group: PROCESS
# note: DYNAMO PROCESS ORGANIZED AND GROUPED IN STEPS SO THAT OTHER USERS CAN UNDERSTAND THE LOGIC OF THE SCRIPT IN ORDER TO CUSTOMIZE THE SCRIPT OR REUSE PORTION OF THE LOGIC TO IMPLEMENT NEW WORKFLOWS
# note: PROCESS DATA

# group: INPUT
# note: SCRIPT INPUT REQUIRED TO RUN THE SCRIPT. THESE INCLUDE INPUTS THAT ARE LESS LIKEY TO CHANGE FOR OTHER USERS TO IMPLEMENT THE SCRIPT ON THEIR PROJECT
# note: SECONDARY INPUT (OPTIONAL)

# group: INPUT
# note: PRIMARY INPUT REQUIRED TO RUN THE SCRIPT. THESE INCLUDES INPUTS THAT OTHER USERS NEED TO PROVIDE IN ORDER TO ADAPT THE WORKFLOW TO THEIR PROJECTS
# note: PRIMARY INPUT

# group: GENERAL
# note: CUSTOM NODE: MeasureMultipleLinesLength
# DESCRIPTION: Display in a message box the total length of selected lines
# REVIT VERSION 2017
# DYNAMO 1.3.0
# DEPENDENT PACKAGES: CLOCKWORK, SPRING NODES
# AUTHOR: Ilaria Giardiello
# DATETIME: 11/27/2017
# REFERENCE: N/A

# group: INPUT
SelectedCurves = Input(SelectedCurves : Element)
RoundingPrecision = Input(RoundingPrecision: double = 1/64)

# group: Measure curves total length
geometry = Element.Geometry(SelectedCurves)
length = Curve.Length(geometry)
flatten = Flatten(length)
sum = Math.Sum(flatten)

# group: RoundUp to defined precision and express in fractional inches
code_block_feet2inches = CodeBlock(x=RoundingPrecision) { x/12; }
# note: Clockwork
roundUpToPrecision = Custom[Math.RoundUpToPrecision](dbl=sum, precision=code_block_feet2inches)  # Rounds a number *up* to a specified precision
# note: Spring Nodes
feet2Fraction = Custom[Feet2Fraction](number=roundUpToPrecision)  # "Springs.Feet2Fraction"; Converts a decimal foot value to a fractional foot/inch string.

# group: Measured length
MeasuredLength = Output(feet2Fraction)

# group: Display message box
python_script = Python(IN[0]=feet2Fraction)
# ---------- python_script.python (15 lines) ----------
import clr
clr.AddReference('ProtoGeometry')
from Autodesk.DesignScript.Geometry import *
#The inputs to this node will be stored as a list in the IN variables.
dataEnteringNode = IN

clr.AddReference('RevitAPIUI')
from Autodesk.Revit.UI import TaskDialog

x = IN[0]

debug = x
msg = str(debug) 
msgbox = TaskDialog
OUT = msgbox.Show("Total lenght", msg)
# ----------------------------------------
