# Dynamo custom node NumberRoomByGrid.dyf (Dynamo 1.2.1.3083)
# category: Sasaki
# update room number by grid crosspoint

# group: Filter Rooms: by hasLocation
Rooms = Input()
location = Room.Location(Rooms)
code_block = CodeBlock(x=location) { x != null; }
filterByBoolMask = List.FilterByBoolMask(list=Rooms, mask=code_block)
location_2 = Room.Location(filterByBoolMask.in)
RoomsWithoutLocation = Output(filterByBoolMask.out)

# group: Filter Grids: by directions, name prefix, Geometry.Line
categories = Categories("Grids")
all_elements_of_category = ElementsOfCategory(categories)
code_block_2 = CodeBlock { {0, 180}; {90, 270}; }
GridPrefix = Input()
python_script_filter_grids = Python(IN[0]=all_elements_of_category, IN[1]=code_block_2.out0, IN[2]=code_block_2.out1, IN[3]=GridPrefix)
# ---------- python_script_filter_grids.python (51 lines) ----------
import clr
clr.AddReference('ProtoGeometry')
from Autodesk.DesignScript.Geometry import *

# Import RevitNodes
clr.AddReference("RevitNodes")
import Revit
clr.ImportExtensions(Revit.Elements)

# Import Revit elements
from Revit.Elements import *

# Import DocumentManager and TransactionManager
clr.AddReference("RevitServices")
import RevitServices
from RevitServices.Persistence import DocumentManager
from RevitServices.Transactions import TransactionManager

# Import RevitAPI
clr.AddReference("RevitAPI")
import Autodesk
from Autodesk.Revit.DB import *

grids = IN[0]
directions_h = IN[1]
directions_v = IN[2]
grid_prefix = IN[3]

vertical_grids = []
horizontal_grids = []

def vector_angle(vecA):
	x_axis = XYZ(1,0,0)
	arc = x_axis.AngleTo(XYZ(vecA.X, vecA.Y, vecA.Z))
	angle = arc / 3.1415926 * 180
	return int(round(angle))

for grid in grids:	

	# filter by Geometry.Line, grid_prefix, directions
	angle = vector_angle(grid.Curve.Direction)
	if grid.Curve.GetType().Name == "Line" and \
	grid.Name.startswith(grid_prefix) and \
	(angle in directions_h or \
	 angle in directions_v):
	 	if angle in directions_v:
			vertical_grids.append(grid)
		elif angle in directions_h:
			horizontal_grids.append(grid)			
	
OUT = vertical_grids, horizontal_grids
# ----------------------------------------

python_script_get_grid_by_point = Python(IN[0]=location_2, IN[1]=python_script_filter_grids)
# ---------- python_script_get_grid_by_point.python (122 lines) ----------
import clr
clr.AddReference('ProtoGeometry')
from Autodesk.DesignScript.Geometry import *

# Import RevitNodes
clr.AddReference("RevitNodes")
import Revit
clr.ImportExtensions(Revit.Elements)

# Import Revit elements
from Revit.Elements import *

# Import DocumentManager and TransactionManager
clr.AddReference("RevitServices")
import RevitServices
from RevitServices.Persistence import DocumentManager
from RevitServices.Transactions import TransactionManager

# Import RevitAPI
clr.AddReference("RevitAPI")
import Autodesk
from Autodesk.Revit.DB import *

group_points = IN[0]
grids = IN[1]
grids_h = grids[0]
grids_v = grids[1]


def is_point_on_line_segment(intersection, line):
	minX = min(line[0][0], line[1][0])
	maxX = max(line[0][0], line[1][0])
	minY = min(line[0][1], line[1][1])
	maxY = max(line[0][1], line[1][1])
	return intersection.X >= minX and \
		   intersection.X <= maxX and \
		   intersection.Y >= minY and \
		   intersection.Y <= maxY


def is_point_on_line_segments(intersection, line1, line2):
	return is_point_on_line_segment(intersection, line1) and is_point_on_line_segment(intersection, line2)


def line_intersection(Line1, Line2):
    line1 = [[Line1.StartPoint.X, Line1.StartPoint.Y], [Line1.EndPoint.X, Line1.EndPoint.Y]]
    line2 = [[Line2.StartPoint.X, Line2.StartPoint.Y], [Line2.EndPoint.X, Line2.EndPoint.Y]]
    xdiff = (line1[0][0] - line1[1][0], line2[0][0] - line2[1][0])
    ydiff = (line1[0][1] - line1[1][1], line2[0][1] - line2[1][1])

    def det(a, b):
        return a[0] * b[1] - a[1] * b[0]

    div = det(xdiff, ydiff)
    if div == 0:
       raise Exception('lines do not intersect')

    d = (det(*line1), det(*line2))
    x = det(d, xdiff) / div
    y = det(d, ydiff) / div
    
    intersection = XYZ(x, y, 0)
    #return intersection
    if is_point_on_line_segments(intersection, line1, line2):
    	return intersection
    else:
    	return None
    

def coor_to_str(intersection):
	return str(int(intersection.X)) + "_" + str(int(intersection.Y))

def get_grids_intersections(grids_h, grids_v):
	intersections = []   
	intersection_grids = {}
	for grid_h in grids_h:    
		for grid_v in grids_v:
			grid_line_h = grid_h.Curve
			grid_line_v = grid_v.Curve
			
			intersection = line_intersection(grid_line_h, grid_line_v)
			if intersection is not None:
				intersections.append(intersection)
				key = coor_to_str(intersection)
				intersection_grids[key] = [grid_h, grid_v]			
	return intersections, intersection_grids
	
	
def get_closest_points(startList, targetList):
	closest_points = []
	for startPoint in startList:
		closestPoint = targetList[0]
		closestDist = -1
		for targetPoint in targetList:
			dist = pow(abs(targetPoint.X - startPoint.X), 2) + \
					   pow(abs(targetPoint.Y - startPoint.Y), 2) + \
					   pow(abs(targetPoint.Z - startPoint.Z), 2)
			if closestDist == -1 or closestDist > dist:
				closestDist = dist
				closestPoint = targetPoint
				
		closest_points.append(closestPoint)
	return closest_points
	
	
def get_closest_grids(intersections, intersection_grids):	
	closest_grids_h = []
	closest_grids_v = []
	for intersection in intersections:
		key = coor_to_str(intersection)
		closest_grids = intersection_grids[key]
		closest_grids_h.append(closest_grids[0].Name)
		closest_grids_v.append(closest_grids[1].Name)
	return closest_grids_h, closest_grids_v
	

def main():
	intersections, intersection_grids = get_grids_intersections(grids_h, grids_v)
	closest_points = get_closest_points(group_points, intersections)
	return get_closest_grids(closest_points, intersection_grids)

OUT = main()
# ----------------------------------------

# group: Set Level Name
LevelNames = Input()
LevelNumbers = Input()
string = StringInput("Level")
getParameterValueByName = Element.GetParameterValueByName(element=filterByBoolMask.in, parameterName=string)
byKeysValues = Custom[Springs.Dictionary.ByKeysValues](keys=LevelNames, values=LevelNumbers, searchKeys=getParameterValueByName)  # Dictionaries are an incredibly powerful tool for making associative sets between two equal length lists. The first list must be of unique strings (or numbers) and will be the key and the second list will be the matching values (it can be made up of geometry, elements, even other lists) The search keys list will provide the corresponding value to the input key.

# group: Concate Labels: level + grid
GridXYSeparator = Input()
GridOrder = Input()
python_script_concat_grid_label = Python(IN[0]=python_script_get_grid_by_point, IN[1]=GridPrefix, IN[2]=GridXYSeparator, IN[3]=GridOrder)
# ---------- python_script_concat_grid_label.python (42 lines) ----------
import clr
clr.AddReference('ProtoGeometry')
from Autodesk.DesignScript.Geometry import *

# Import RevitNodes
clr.AddReference("RevitNodes")
import Revit
clr.ImportExtensions(Revit.Elements)

# Import Revit elements
from Revit.Elements import *

# Import DocumentManager and TransactionManager
clr.AddReference("RevitServices")
import RevitServices
from RevitServices.Persistence import DocumentManager

# Import RevitAPI
clr.AddReference("RevitAPI")
import Autodesk
from Autodesk.Revit.DB import *

vertical_grids = IN[0][0]
horizontal_grids = IN[0][1]
grid_prefix = IN[1]
seperator = IN[2]
order = IN[3]

labels = []
ngrid = len(vertical_grids)
prefix_len = len(grid_prefix)

for i in range(ngrid):
	vertical_label = vertical_grids[i][prefix_len:]
	horizontal_label = horizontal_grids[i][prefix_len:]
	label = ""
	if order == "hv":
		label = horizontal_label + seperator + vertical_label
	elif order == "vh":
		label = vertical_label + seperator + horizontal_label
	labels.append(label)
OUT = labels
# ----------------------------------------
LevelGridSeparator = Input()
python_script_concat_grid_level = Python(IN[0]=python_script_concat_grid_label, IN[1]=byKeysValues, IN[2]=LevelGridSeparator)  # "Python Script: concat grid & level label"
# ---------- python_script_concat_grid_level.python (38 lines) ----------
import clr
clr.AddReference('ProtoGeometry')
from Autodesk.DesignScript.Geometry import *

# Import RevitNodes
clr.AddReference("RevitNodes")
import Revit
clr.ImportExtensions(Revit.Elements)

# Import Revit elements
from Revit.Elements import *

# Import DocumentManager and TransactionManager
clr.AddReference("RevitServices")
import RevitServices
from RevitServices.Persistence import DocumentManager

# Import RevitAPI
clr.AddReference("RevitAPI")
import Autodesk
from Autodesk.Revit.DB import *

grid_labels = IN[0]
level_labels = IN[1]
seperator = IN[2]

labels = []
nlabel = len(grid_labels)

for i in range(nlabel):
	label = level_labels[i] + seperator + grid_labels[i]
	labels.append(label)
OUT = labels
	
	
	
	
	
# ----------------------------------------
code_block_3 = CodeBlock(RoomNumbers=python_script_concat_grid_level) { RoomNumbers; }

# group: Setup Room Number
string_2 = StringInput("Number")
setParameterByName = Element.SetParameterByName(element=filterByBoolMask.in, parameterName=string_2, value=python_script_concat_grid_level)

RoomNumbers = Output(setParameterByName)
