# Dynamo custom node PlaceScheduleOnSheet.dyf (Dynamo 1.2.1.3083)
# category: Sasaki
# Place schedule on sheet

RevitSheet = Input()
RevitSchedule = Input()
ScheduleLocation = Input()
python_script = Python(IN[0]=RevitSheet, IN[1]=RevitSchedule, IN[2]=ScheduleLocation)
# ---------- python_script.python (41 lines) ----------
import clr
clr.AddReference('ProtoGeometry')
from Autodesk.DesignScript.Geometry import *

# Import RevitNodes
clr.AddReference("RevitNodes")
import Revit
clr.ImportExtensions(Revit.Elements)

# Import Revit elements
from Revit.Elements import *

# Import DocumentManager and TransactionManager
clr.AddReference("RevitServices")
import RevitServices
from RevitServices.Persistence import DocumentManager
from RevitServices.Transactions import TransactionManager

# Import RevitAPI
clr.AddReference("RevitAPI")
import Autodesk
from Autodesk.Revit.DB import *

import System

doc = DocumentManager.Instance.CurrentDBDocument
sheet = IN[0]
sheetId = Autodesk.Revit.DB.ElementId(sheet.Id)
schedule = IN[1]
scheduleId = Autodesk.Revit.DB.ElementId(schedule.Id)
offset = IN[2]
origin = Autodesk.Revit.DB.XYZ(offset.X, offset.Y, offset.Z)

try:
	TransactionManager.Instance.EnsureInTransaction(doc)
	scheduleSheet = ScheduleSheetInstance.Create(doc, sheetId, scheduleId, origin)
	TransactionManager.Instance.TransactionTaskDone()
	OUT = "succeed"
except:
	OUT = "failed"
    
# ----------------------------------------
Status = Output(python_script)
