# Dynamo custom node PlaceViewOnSheet.dyf (Dynamo 1.2.1.3083)
# category: Sasaki
# Place View on Sheet

categories = Categories("Sheets")
all_elements_of_category = ElementsOfCategory(categories)
SheetNumbers = Input()
filterSortSheetByNumber = Python(IN[0]=all_elements_of_category, IN[1]=SheetNumbers)
# ---------- filterSortSheetByNumber.python (26 lines) ----------
import clr
clr.AddReference('RevitAPI')
from Autodesk.Revit.DB import *

clr.AddReference("RevitNodes")
import Revit
clr.ImportExtensions(Revit.Elements)

clr.AddReference("RevitServices")
import RevitServices
from RevitServices.Persistence import DocumentManager
from RevitServices.Transactions import TransactionManager

doc = DocumentManager.Instance.CurrentDBDocument

sheets = IN[0]
sheet_numbers = IN[1]
ans = []

for sheet in sheets:
	if sheet.SheetNumber in sheet_numbers:
		ans.append(sheet)
		
ans = sorted(ans, key=lambda x: sheet_numbers.index(x.SheetNumber))
		
OUT = ans
# ----------------------------------------
categories_2 = Categories("Views")
all_elements_of_category_2 = ElementsOfCategory(categories_2)
ViewNames = Input()
filterSortViewByName = Python(IN[0]=all_elements_of_category_2, IN[1]=ViewNames)
# ---------- filterSortViewByName.python (26 lines) ----------
import clr
clr.AddReference('RevitAPI')
from Autodesk.Revit.DB import *

clr.AddReference("RevitNodes")
import Revit
clr.ImportExtensions(Revit.Elements)

clr.AddReference("RevitServices")
import RevitServices
from RevitServices.Persistence import DocumentManager
from RevitServices.Transactions import TransactionManager

doc = DocumentManager.Instance.CurrentDBDocument

views = IN[0]
view_names = IN[1]
ans = []

for view in views:
	if view.Name in view_names:
		ans.append(view)
		
ans = sorted(ans, key=lambda x: view_names.index(x.Name))

OUT = ans
# ----------------------------------------
LocationX = Input()
LocationY = Input()
placeViewOnSheet = Python(IN[0]=filterSortSheetByNumber, IN[1]=filterSortViewByName, IN[2]=LocationX, IN[3]=LocationY)
# ---------- placeViewOnSheet.python (31 lines) ----------
#Put view on sheet
import clr
clr.AddReference('RevitAPI')
from Autodesk.Revit.DB import *

clr.AddReference("RevitNodes")
import Revit
clr.ImportExtensions(Revit.Elements)

clr.AddReference("RevitServices")
import RevitServices
from RevitServices.Persistence import DocumentManager
from RevitServices.Transactions import TransactionManager

doc = DocumentManager.Instance.CurrentDBDocument
sheets = IN[0]
views = IN[1]
x = IN[2]
y = IN[3]
viewsplaced = list()


TransactionManager.Instance.EnsureInTransaction(doc) 
for number in range(len(sheets)):
	sheet = UnwrapElement(sheets[number])
	view = UnwrapElement(views[number])
	Viewport.Create(doc, sheet.Id, view.Id, XYZ(x,y,0))
	viewsplaced.append(view.ToDSType(False))
TransactionManager.Instance.TransactionTaskDone()

OUT = viewsplaced
# ----------------------------------------
PlacedViews = Output(placeViewOnSheet)
