# Dynamo custom node RenumberViewports.dyf (Dynamo 1.2.1.3083)
# category: Sasaki
# Renumber Viewports on a Sheet

SheetNumber = Input()

# group: Get Views on the Sheet
categories = Categories("Sheets")
all_elements_of_category = ElementsOfCategory(categories)
code_block = CodeBlock { "Sheet Number"; }
getParameterValueByName = Element.GetParameterValueByName(element=all_elements_of_category, parameterName=code_block)
watch = Watch(getParameterValueByName)
eq = watch == SheetNumber
filterByBoolMask = List.FilterByBoolMask(list=all_elements_of_category, mask=eq)
code_block_2 = CodeBlock { 0; }
code_block_3 = CodeBlock(list=filterByBoolMask.in, x=code_block_2) { list[x]; }
viewports = Archilab.Grimshaw.Views.Sheet.Viewports(code_block_3)

# group: Filter out Legend Views
code_block_4 = CodeBlock { "Detail Number"; }
getParameterValueByName_2 = Element.GetParameterValueByName(element=viewports, parameterName=code_block_4)
code_block_5 = CodeBlock(x=getParameterValueByName_2) { x != "-"; }
filterByBoolMask_2 = List.FilterByBoolMask(list=viewports, mask=code_block_5)

# group: Get View Title Bottom Right Corner
python_script = Python(IN[0]=filterByBoolMask_2.in)
# ---------- python_script.python (44 lines) ----------
import clr
clr.AddReference('ProtoGeometry')
from Autodesk.DesignScript.Geometry import *

# Import RevitNodes
clr.AddReference("RevitNodes")
import Revit
clr.ImportExtensions(Revit.Elements)

# Import Revit elements
from Revit.Elements import *

# Import geometry conversion extension methods
clr.ImportExtensions(Revit.GeometryConversion)

# Import DocumentManager and TransactionManager
clr.AddReference("RevitServices")
import RevitServices
from RevitServices.Persistence import DocumentManager
from RevitServices.Transactions import TransactionManager

# Import RevitAPI
clr.AddReference("RevitAPI")
import Autodesk
from Autodesk.Revit.DB import *

import System

doc = DocumentManager.Instance.CurrentDBDocument
viewports = IN[0]

pts = []

for viewport in viewports:
	viewportId = Autodesk.Revit.DB.ElementId(viewport.Id)
	viewportObj = doc.GetElement(viewportId)
	labelOutline = viewportObj.GetLabelOutline()
	minpt=labelOutline.MinimumPoint.ToPoint()
	maxpt=labelOutline.MaximumPoint.ToPoint()
		
	pts.append(maxpt)

	OUT = pts
	
# ----------------------------------------
python_script_2 = Python(IN[0]=filterByBoolMask_2.in)
# ---------- python_script_2.python (44 lines) ----------
import clr
clr.AddReference('ProtoGeometry')
from Autodesk.DesignScript.Geometry import *

# Import RevitNodes
clr.AddReference("RevitNodes")
import Revit
clr.ImportExtensions(Revit.Elements)

# Import Revit elements
from Revit.Elements import *

# Import geometry conversion extension methods
clr.ImportExtensions(Revit.GeometryConversion)

# Import DocumentManager and TransactionManager
clr.AddReference("RevitServices")
import RevitServices
from RevitServices.Persistence import DocumentManager
from RevitServices.Transactions import TransactionManager

# Import RevitAPI
clr.AddReference("RevitAPI")
import Autodesk
from Autodesk.Revit.DB import *

import System

doc = DocumentManager.Instance.CurrentDBDocument
viewports = IN[0]

pts = []

for viewport in viewports:
	viewportId = Autodesk.Revit.DB.ElementId(viewport.Id)
	viewportObj = doc.GetElement(viewportId)
	labelOutline = viewportObj.GetLabelOutline()
	minpt=labelOutline.MinimumPoint.ToPoint()
	maxpt=labelOutline.MaximumPoint.ToPoint()
		
	pts.append(minpt)

	OUT = pts
	
# ----------------------------------------

# group: Get Title Block on the Sheet
categories_2 = Categories("TitleBlocks")
all_elements_of_category_2 = ElementsOfCategory(categories_2)
code_block_6 = CodeBlock { "Sheet Number"; }
getParameterValueByName_3 = Element.GetParameterValueByName(element=all_elements_of_category_2, parameterName=code_block_6)
eq_2 = SheetNumber == getParameterValueByName_3
filterByBoolMask_3 = List.FilterByBoolMask(list=all_elements_of_category_2, mask=eq_2)

location = FamilyInstance.Location(filterByBoolMask_3.in)

# group: Set Width
code_block_7 = CodeBlock { "SHEET_WIDTH"; }
get_built_in_parameter = Custom[Get Built In Parameter](ParameterNames=code_block_7, Elements=filterByBoolMask_3.in)  # This node will take an input of a built in parameter name and element to return that parameters value.
X = Point.X(location)
code_block_8 = CodeBlock(width=get_built_in_parameter, x=X) { width+x; }

Right_Margin = Input()
sub = code_block_8 - Right_Margin
Left_Margin = Input()
add = X + Left_Margin

# group: Get Minimum Viewport
python_script_3 = Python(IN[0]=viewports)
# ---------- python_script_3.python (47 lines) ----------
import clr
clr.AddReference('ProtoGeometry')
from Autodesk.DesignScript.Geometry import *

# Import RevitNodes
clr.AddReference("RevitNodes")
import Revit
clr.ImportExtensions(Revit.Elements)

# Import Revit elements
from Revit.Elements import *

# Import DocumentManager and TransactionManager
clr.AddReference("RevitServices")
import RevitServices
from RevitServices.Persistence import DocumentManager
from RevitServices.Transactions import TransactionManager

# Import RevitAPI
clr.AddReference("RevitAPI")
import Autodesk
from Autodesk.Revit.DB import *

import System

doc = DocumentManager.Instance.CurrentDBDocument
viewports = IN[0]

widths = []
heights = []

for viewport in viewports:
	viewportId = Autodesk.Revit.DB.ElementId(viewport.Id)
	viewportObj = doc.GetElement(viewportId)
	box = viewportObj.GetBoxOutline()
	maxPt = box.MaximumPoint
	minPt = box.MinimumPoint
	
	w = maxPt.X - minPt.X
	h = maxPt.Y - minPt.Y
	widths.append(w)
	heights.append(h)
	
minW = min(widths)
minH = min(heights)
	
OUT = minW, minH
# ----------------------------------------
code_block_9 = CodeBlock(x=python_script_3) { x[0]; }
code_block_10 = CodeBlock(x=python_script_3) { x[1]; }

# group: X Grid
sub_2 = sub - add
div = sub_2 / code_block_9
ceiling = Math.Ceiling(div)
div_2 = sub_2 / ceiling

# group: X Sort
X_2 = Point.X(python_script)
div_3 = X_2 / div_2  # lacing=Longest
code_block_11 = CodeBlock(x=div_3) { x+1; }
floor = Math.Floor(code_block_11)

# group: Set Height
code_block_12 = CodeBlock { "SHEET_HEIGHT"; }
get_built_in_parameter_2 = Custom[Get Built In Parameter](ParameterNames=code_block_12, Elements=filterByBoolMask_3.in)
Y = Point.Y(location)
code_block_13 = CodeBlock(height=get_built_in_parameter_2, y=Y) { height+y; }

Top_Margin = Input()
sub_3 = code_block_13 - Top_Margin
Bottom_Margin = Input()
add_2 = Y + Bottom_Margin

# group: Y Grid
sub_4 = sub_3 - add_2
div_4 = sub_4 / code_block_10
ceiling_2 = Math.Ceiling(div_4)
div_5 = sub_4 / ceiling_2

# group: Y Sort
Y_2 = Point.Y(python_script_2)
div_6 = Y_2 / div_5  # lacing=Longest
code_block_14 = CodeBlock(y=div_6) { y+1; }
floor_2 = Math.Floor(code_block_14)

# group: Sort Viewport by X/Y Grid Number
SortOrder = Input()
python_script_4 = Python(IN[0]=floor, IN[1]=floor_2, IN[2]=SortOrder)
# ---------- python_script_4.python (52 lines) ----------
import clr
clr.AddReference('ProtoGeometry')
from Autodesk.DesignScript.Geometry import *
#The inputs to this node will be stored as a list in the IN variables.

#Assign your output to the OUT variable.

cxs = IN[0]
cys = IN[1]
priority = IN[2]

pts = []
nums = len(cxs)
order = []

def greaterX(a, b):
	if a[0] == b[0]:
		if a[1] > b[1]:
			return 1
		else:
			return -1
	else:
		if a[0] > b[0]:
			return -1
		else:
			return 1
			
def greaterY(a, b):
	if a[1] == b[1]:
		if a[0] > b[0]:
			return -1
		else:
			return 1
	else:
		if a[1] > b[1]:
			return 1
		else:
			return -1
					
for i in range(0, nums):
	pts.append([cxs[i], cys[i]])
	
if priority == "x":
	ans = sorted(pts, cmp = greaterX)
elif priority == "y":
	ans = sorted(pts, cmp = greaterY)

for pt in pts:
	index = ans.index(pt)
	order.append(str(index + 1))

OUT = order
# ----------------------------------------

Viewport_Order = Output(python_script_4)
watch_2 = Watch(floor)
watch_3 = Watch(floor_2)
watch_4 = Watch(div_2)
watch_5 = Watch(div_5)
watch_6 = Watch(code_block_9)

# group: Set Viewport Numbers
code_block_15 = CodeBlock { "VIEWPORT_DETAIL_NUMBER"; }
set_builtin_parameter = Custom[Set BuiltIn Parameter](ParameterName=code_block_15, Elements=filterByBoolMask_2.in, ParameterValues=python_script_4)  # This node will take an input of a built in parameter name and set that parameter to given value for given elements.
code_block_16 = CodeBlock(output=set_builtin_parameter) { output == 0; }
Succeed = Output(code_block_16)

# group: Set temporary detail numbers to avoid dupicates
code_block_17 = CodeBlock { "VIEWPORT_DETAIL_NUMBER"; }
get_built_in_parameter_3 = Custom[Get Built In Parameter](ParameterNames=code_block_17, Elements=viewports)
code_block_18 = CodeBlock { "_dedup"; }
code_block_19 = CodeBlock(a=get_built_in_parameter_3, b=code_block_18) { a+b; }
watch_7 = Watch(code_block_19)
set_builtin_parameter_2 = Custom[Set BuiltIn Parameter](ParameterName=code_block_17, Elements=viewports, ParameterValues=code_block_19)
