# Dynamo custom node RevisionCloudSheets.dyf (Dynamo 1.3.0.875)
# category: Sasaki
# Identify all sheets containing revision clouds for the selected revision

# group: OUTPUT
# note: SCRIPT OUTPUT MIGHT INCLUDE DATA OR SIMPLY NOTIFICATION OF WHETHER THE SCRIPT RAN SUCCESSFULLY. HIGHLIGHTING THE OUTPUT OR FINAL STEP WILL HELP OTHER USERS TO QUICKLY IDENTIFY WHERE TO LOOK FOR RESULTS
# note: SCRIPT OUTPUT

# group: PROCESS
# note: DYNAMO PROCESS ORGANIZED AND GROUPED IN STEPS SO THAT OTHER USERS CAN UNDERSTAND THE LOGIC OF THE SCRIPT IN ORDER TO CUSTOMIZE THE SCRIPT OR REUSE PORTION OF THE LOGIC TO IMPLEMENT NEW WORKFLOWS
# note: PROCESS DATA

# group: INPUT
# note: SCRIPT INPUT REQUIRED TO RUN THE SCRIPT. THESE INCLUDE INPUTS THAT ARE LESS LIKEY TO CHANGE FOR OTHER USERS TO IMPLEMENT THE SCRIPT ON THEIR PROJECT
# note: SECONDARY INPUT (OPTIONAL)

# group: INPUT
# note: PRIMARY INPUT REQUIRED TO RUN THE SCRIPT. THESE INCLUDES INPUTS THAT OTHER USERS NEED TO PROVIDE IN ORDER TO ADAPT THE WORKFLOW TO THEIR PROJECTS
# note: PRIMARY INPUT

# group: GENERAL
# note: CUSTOM NODE: RevisionSheetsList
# DESCRIPTION: Identify all sheets containing revision clouds for the selected revision.
# REVIT VERSION 2017
# DYNAMO 1.3.0
# DEPENDENT PACKAGES: CLOCKWORK
# AUTHOR: Gloriana Gonzales
# DATETIME: 05/22/2017
# LAST UPDATE: Ilaria Giardiello
# DATETIME: 02/08/2017
# REFERENCE: N/A

# group: SELECT ALL REVISION CLOUDS IN THE PROJECT
categories = Categories("RevisionClouds")
all_elements_of_category = ElementsOfCategory(categories)

# group: INPUT
RevisionNumber = Input(RevisionNumber : string)

# group: SELECT THE CLOUDS BELONGING TO THE SELECTED REVISION
code_block = CodeBlock { "Revision"; }
getParameterValueByName = Element.GetParameterValueByName(element=all_elements_of_category, parameterName=code_block)
name = Element.Name(getParameterValueByName)
contains = String.Contains(str=name, searchFor=RevisionNumber)
filterByBoolMask = List.FilterByBoolMask(list=name, mask=contains)

# group: SELECT VIEWS CONTAINING REVISION CLOUDS
# note: ClockWork
ownerView = Custom[Element.OwnerView](element=all_elements_of_category)  # Gets the owner view of a given Revit element (if possible)
filterByBoolMask_2 = List.FilterByBoolMask(list=ownerView, mask=contains)

# group: REVISION VIEWS
ViewsContaingClouds = Output(filterByBoolMask_2.in)

# group: SELECT SHEETS CONTAINING CLOUDS - SHEET NUMBERS
code_block_2 = CodeBlock { "Sheet Number"; }
getParameterValueByName_2 = Element.GetParameterValueByName(element=filterByBoolMask_2.in, parameterName=code_block_2)
code_block_3 = CodeBlock { "---"; }
eq = getParameterValueByName_2 == code_block_3
filterByBoolMask_3 = List.FilterByBoolMask(list=getParameterValueByName_2, mask=eq)
sort = List.Sort(filterByBoolMask_3.out)
uniqueItems = List.UniqueItems(sort)

# group: REVISION SHEETS NUMBER
SheetsContaingClouds_Nr = Output(uniqueItems)

# group: GET SHEET NAMES
categories_2 = Categories("Sheets")
all_elements_of_category_2 = ElementsOfCategory(categories_2)
filterSortSheetByNumber = Python(IN[0]=all_elements_of_category_2, IN[1]=uniqueItems)
# ---------- filterSortSheetByNumber.python (26 lines) ----------
import clr
clr.AddReference('RevitAPI')
from Autodesk.Revit.DB import *

clr.AddReference("RevitNodes")
import Revit
clr.ImportExtensions(Revit.Elements)

clr.AddReference("RevitServices")
import RevitServices
from RevitServices.Persistence import DocumentManager
from RevitServices.Transactions import TransactionManager

doc = DocumentManager.Instance.CurrentDBDocument

sheets = IN[0]
sheet_numbers = IN[1]
ans = []

for sheet in sheets:
	if sheet.SheetNumber in sheet_numbers:
		ans.append(sheet)
		
ans = sorted(ans, key=lambda x: sheet_numbers.index(x.SheetNumber))
		
OUT = ans
# ----------------------------------------
name_2 = Element.Name(filterSortSheetByNumber)

# group: REVISION SHEETS NAME
SheetsContaingClouds_Name = Output(name_2)
