# Dynamo graph AddWorksetsFromExcel.dyn (Dynamo 1.2.1.3083)

# group: BEFORE YOU RUN THIS
# note: Please make sure that your file is a Central file

# group: activate
# note: Activate the node by setting the toggle to True. Remeber to Run the graph if dyanmo run mode is set to Manual
boolean = BoolSelector(false)

# group: read worksets settings from Excel
file_path = Filename(".\AddWorksets.xlsx")
fromPath = FileObject(file_path)  # "File.FromPath"
# note: Type Architecture or Interiors to select the discipline
string = StringInput("Architecture")
readFromFile = Excel.ReadFromFile(file=fromPath, sheetName=string)

addWorksets = Custom[AddWorksets](Activate=boolean, AddWorksets=readFromFile)  # Add standards worksets to central file and set their default visibility setting Input "Activate": bool. Set to true to run the node default value: "false" optional: - "AddWorksets": {{string,bool}, {string, bool}}. List of worksets to add to the central file and their corresponding default visibility setting. Example: {{WorksetName, true}, {WorksetName, false}} default value: Embedded in the node (SA standard worsets) optional: - Output "NewWorksets": {string}. Worksets successfully added to the central file. The node will only add worksets that are not existing yet optional: -

# group: new worksets
# note: List of workset names successfully added to the central file
watch = Watch(addWorksets)
