# Dynamo graph CreateLevelsByElevation.dyn (Dynamo 1.2.1.3083)

# group: elevation information
set_base_elevation = DoubleSlider(26, range=0..100 step 0.1)
set_floor_to_floor_height = DoubleSlider(13, range=0..100 step 0.1)

# group: level information
set_number_of_levels = IntegerSlider(6, range=0..100 step 1)
set_start_level_number = IntegerSlider(1, range=0..100 step 1)

createLevelsByElevation = Custom[CreateLevelsByElevation](BaseElevation=set_base_elevation, NumberOfLevel=set_number_of_levels, FloorToFloorHeight=set_floor_to_floor_height, BaseLevelNumber=set_start_level_number)  # Create levels by elevation

# group: levels
# note: Levels: level(s) created successfully
watch = Watch(createLevelsByElevation)
