# Dynamo graph CreatePlanViewFromLevel.dyn (Dynamo 1.3.0.875)

# group: OUTPUT
# note: SCRIPT OUTPUT MIGHT INCLUDE DATA OR SIMPLY NOTIFICATION OF WHETHER THE SCRIPT RAN SUCCESSFULLY. HIGHLIGHTING THE OUTPUT OR FINAL STEP WILL HELP OTHER USERS TO QUICKLY IDENTIFY WHERE TO LOOK FOR RESULTS
# note: SCRIPT OUTPUT

# group: PROCESS
# note: DYNAMO PROCESS ORGANIZED AND GROUPED IN STEPS SO THAT OTHER USERS CAN UNDERSTAND THE LOGIC OF THE SCRIPT IN ORDER TO CUSTOMIZE THE SCRIPT OR REUSE PORTION OF THE LOGIC TO IMPLEMENT NEW WORKFLOWS
# note: PROCESS DATA

# group: INPUT
# note: SCRIPT INPUT REQUIRED TO RUN THE SCRIPT. THESE INCLUDE INPUTS THAT ARE LESS LIKEY TO CHANGE FOR OTHER USERS TO IMPLEMENT THE SCRIPT ON THEIR PROJECT
# note: SECONDARY INPUT (OPTIONAL)

# group: INPUT
# note: PRIMARY INPUT REQUIRED TO RUN THE SCRIPT. THESE INCLUDES INPUTS THAT OTHER USERS NEED TO PROVIDE IN ORDER TO ADAPT THE WORKFLOW TO THEIR PROJECTS
# note: PRIMARY INPUT

# group: GENERAL
# note: CUSTOM NODE: CreatePlanViewsFromLevels
# DESCRIPTION: Automatically create Plan Views from selected levels, name them according to BPM standards, apply the selected view template and apply a scope box for view crop
# REVIT VERSION 2017
# DYNAMO 1.3.0
# DEPENDENT PACKAGES: STEAMNODES, CLOCKWORK
# AUTHOR: Ilaria Giardiello
# DATETIME: 11/27/2017
# REFERENCE: N/A

# group: INPUT
code_block_selectedlevelsname = CodeBlock()
# ---------- code_block_selectedlevelsname.designscript (2 lines) ----------
{"LEVEL 1",
"LEVEL 2"};
# ----------------------------------------
boolean_is_the_view_a_working = BoolSelector(false)  # "Boolean - Is the View a Working view?"
string_viewprefix = StringInput("FLOOR PLAN")
string_viewtemplate = StringInput("A1.00 Architectural Plan")
string_scopebox = StringInput("Scope Box 1")

# group: SASAKI PACKAGE CreatePlanViewFromLevel
createPlanViewFromLevel = Custom[CreatePlanViewFromLevel](LevelsName=code_block_selectedlevelsname, IsWorkingView=boolean_is_the_view_a_working, ViewPrefix=string_viewprefix, SelectViewTemplate=string_viewtemplate, ScopeBox=string_scopebox)  # Automatically create Plan Views from selected levels, name them according to BPM standards, apply the selected view template and apply a scope box for view crop

# group: SUCCESSFULLY CRATED VIEWS
watch = Watch(createPlanViewFromLevel)

# group: INPUT
code_block = CodeBlock { SheetNumbers; }  # unwired: SheetNumbers
code_block_2 = CodeBlock { ViewNames; }  # unwired: ViewNames
code_block_3 = CodeBlock { LocationX; }  # unwired: LocationX
code_block_4 = CodeBlock { LocationY; }  # unwired: LocationY

# group: SORT AND FILTER SHEETS BY NUMBER
categories = Categories("Sheets")
all_elements_of_category = ElementsOfCategory(categories)
filterSortSheetByNumber = Python(IN[0]=all_elements_of_category, IN[1]=code_block)
# ---------- filterSortSheetByNumber.python (26 lines) ----------
import clr
clr.AddReference('RevitAPI')
from Autodesk.Revit.DB import *

clr.AddReference("RevitNodes")
import Revit
clr.ImportExtensions(Revit.Elements)

clr.AddReference("RevitServices")
import RevitServices
from RevitServices.Persistence import DocumentManager
from RevitServices.Transactions import TransactionManager

doc = DocumentManager.Instance.CurrentDBDocument

sheets = IN[0]
sheet_numbers = IN[1]
ans = []

for sheet in sheets:
	if sheet.SheetNumber in sheet_numbers:
		ans.append(sheet)
		
ans = sorted(ans, key=lambda x: sheet_numbers.index(x.SheetNumber))
		
OUT = ans
# ----------------------------------------

# group: SORT AND FILTER SHEETS BY NAME
categories_2 = Categories("Views")
all_elements_of_category_2 = ElementsOfCategory(categories_2)
filterSortViewByName = Python(IN[0]=all_elements_of_category_2, IN[1]=code_block_2)
# ---------- filterSortViewByName.python (28 lines) ----------
import clr
clr.AddReference('RevitAPI')
from Autodesk.Revit.DB import *

clr.AddReference("RevitNodes")
import Revit
clr.ImportExtensions(Revit.Elements)

clr.AddReference("RevitServices")
import RevitServices
from RevitServices.Persistence import DocumentManager
from RevitServices.Transactions import TransactionManager

doc = DocumentManager.Instance.CurrentDBDocument

views = IN[0]
view_names = IN[1]
ans = []

for view in views:
	if view is None:
		continue
	if view.Name in view_names:
		ans.append(view)
		
ans = sorted(ans, key=lambda x: view_names.index(x.Name))

OUT = ans
# ----------------------------------------

# group: PLACE VIEW ON SHEET
placeViewOnSheet = Python(IN[0]=filterSortSheetByNumber, IN[1]=filterSortViewByName, IN[2]=code_block_3, IN[3]=code_block_4)
# ---------- placeViewOnSheet.python (33 lines) ----------
#Put view on sheet
import clr
clr.AddReference('RevitAPI')
from Autodesk.Revit.DB import *

clr.AddReference("RevitNodes")
import Revit
clr.ImportExtensions(Revit.Elements)

clr.AddReference("RevitServices")
import RevitServices
from RevitServices.Persistence import DocumentManager
from RevitServices.Transactions import TransactionManager

doc = DocumentManager.Instance.CurrentDBDocument
sheets = IN[0]
views = IN[1]
x = IN[2]
y = IN[3]
viewsplaced = list()


TransactionManager.Instance.EnsureInTransaction(doc) # you need an active transaction as you will create elements

for number in range(len(sheets)):
	sheet = UnwrapElement(sheets[number])
	view = UnwrapElement(views[number])
	Viewport.Create(doc, sheet.Id, view.Id, XYZ(x,y,0))
	viewsplaced.append(view.ToDSType(False))
	
TransactionManager.Instance.TransactionTaskDone()

OUT = viewsplaced
# ----------------------------------------

# group: PLACED VIEWS
code_block_5 = CodeBlock(PlacedViews=placeViewOnSheet) { PlacedViews; }
