# Dynamo graph CreateSheetsFromExcel.dyn (Dynamo 1.3.0.875)

# group: OUTPUT
# note: SCRIPT OUTPUT MIGHT INCLUDE DATA OR SIMPLY NOTIFICATION OF WHETHER THE SCRIPT RAN SUCCESSFULLY. HIGHLIGHTING THE OUTPUT OR FINAL STEP WILL HELP OTHER USERS TO QUICKLY IDENTIFY WHERE TO LOOK FOR RESULTS
# note: SCRIPT OUTPUT

# group: PROCESS
# note: DYNAMO PROCESS ORGANIZED AND GROUPED IN STEPS SO THAT OTHER USERS CAN UNDERSTAND THE LOGIC OF THE SCRIPT IN ORDER TO CUSTOMIZE THE SCRIPT OR REUSE PORTION OF THE LOGIC TO IMPLEMENT NEW WORKFLOWS
# note: PROCESS DATA

# group: INPUT
# note: SCRIPT INPUT REQUIRED TO RUN THE SCRIPT. THESE INCLUDE INPUTS THAT ARE LESS LIKEY TO CHANGE FOR OTHER USERS TO IMPLEMENT THE SCRIPT ON THEIR PROJECT
# note: SECONDARY INPUT (OPTIONAL)

# group: INPUT
# note: PRIMARY INPUT REQUIRED TO RUN THE SCRIPT. THESE INCLUDES INPUTS THAT OTHER USERS NEED TO PROVIDE IN ORDER TO ADAPT THE WORKFLOW TO THEIR PROJECTS
# note: PRIMARY INPUT

# group: GENERAL
# note: CUSTOM NODE: CreateSheetsFromExcel
# DESCRIPTION: Automatically add Revit Sheets from Excel
# REVIT VERSION 2017
# DYNAMO 1.3.0
# DEPENDENT PACKAGES: NONE
# AUTHOR: Ilaria Giardiello
# DATETIME: 04/15/2016
# REFERENCE: Original script written by James Warne & Matthew Anderle - AECOM

# group: INPUT
file_path_excelfilepath = Filename("L:\Dynamo\Official Release\Official Release - V2\Official Release\sasaki-dynamo-master\extra\CreateSheetsFromExcel\CreateSheetsFromExcel.xlsx")
string_excelsheetname = StringInput("Sheet1")
family_types = FamilyTypes("_SA-TB-CD-3042:_SA-TB-CD-3042")  # "Family Types - TitleBlockFamilyType"

# group: INPUT
boolean_createuncreatedsheets = BoolSelector(true)

# group: SASAKI PACKAGE CreateSheetsFromExcel
createSheetsFromExcel = Custom[CreateSheetsFromExcel](ExcelFilePath=file_path_excelfilepath, ExcelSheetName=string_excelsheetname, TitleBlockFamilyType=family_types, CreateUncreatedSheets=boolean_createuncreatedsheets)  # Automatically add Revit Sheets from Excel

# group: CREATED SHEETS
watch = Watch(createSheetsFromExcel)
sheetNumber = Sheet.SheetNumber(watch)
