# Dynamo graph FormatKeynoteList_2017.dyn (Dynamo 1.3.0.875)

# group: OUTPUT
# note: SCRIPT OUTPUT MIGHT INCLUDE DATA OR SIMPLY NOTIFICATION OF WHETHER THE SCRIPT RAN SUCCESSFULLY. HIGHLIGHTING THE OUTPUT OR FINAL STEP WILL HELP OTHER USERS TO QUICKLY IDENTIFY WHERE TO LOOK FOR RESULTS
# note: SCRIPT OUTPUT

# group: PROCESS
# note: DYNAMO PROCESS ORGANIZED AND GROUPED IN STEPS SO THAT OTHER USERS CAN UNDERSTAND THE LOGIC OF THE SCRIPT IN ORDER TO CUSTOMIZE THE SCRIPT OR REUSE PORTION OF THE LOGIC TO IMPLEMENT NEW WORKFLOWS
# note: PROCESS DATA

# group: INPUT
# note: SCRIPT INPUT REQUIRED TO RUN THE SCRIPT. THESE INCLUDE INPUTS THAT ARE LESS LIKEY TO CHANGE FOR OTHER USERS TO IMPLEMENT THE SCRIPT ON THEIR PROJECT
# note: SECONDARY INPUT (OPTIONAL)

# group: INPUT
# note: PRIMARY INPUT REQUIRED TO RUN THE SCRIPT. THESE INCLUDES INPUTS THAT OTHER USERS NEED TO PROVIDE IN ORDER TO ADAPT THE WORKFLOW TO THEIR PROJECTS
# note: PRIMARY INPUT

# group: GENERAL
# note: DESCRIPTION: This script will import the Master Keynote List from Excel, place the information in a key schedule and automatically format the schedule to group information by section and division, including font formatting and indentations.
# REVIT VERSION 2017
# DYNAMO 1.3.0
# DEPENDENT PACKAGES: ARCHI-LAB GRIMSHAW
# AUTHOR: Ilaria Giardiello
# DATETIME: 02/21/2017
# LAST UPDATE: 02/07/2018
# REFERENCE: N/A

# group: CHECK YOUR DATA IF SOMETHING GOES WRONG
# note: PLEASE CHECK THESE GRAY BOXES TO ANALYZE YOUR DATA IN CASE THE EXCEL SHEETS CONTAINS ERRORS.
# TYPICAL ERRORS INCLUDE:
# - A DESCRIPTION WITHOUT A KEYNOTE
# - A KEYNOTE WITHOUT DESCRIPTION

# group: IMPORTANT BEFORE RUNNING THE SCRIPT
# note: IMPORTANT BEFORE RUNNING THE SCRIPT, CHECK THE BPM ARTICLE. SOME STEPS ARE REQUIRED IN ADVANCE IN ORDER TO RUN THE SCRIPT SUCCESSFULLY

# group: INPUT
views_select_schedule = Views("MATERIAL KEYNOTES LIST")

# group: SORTING
code_block = CodeBlock { SortBy = {"DIVISION", "SECTION"}; ResetSort = {}; {true,true}; {false,false}; {"Ascending", "Ascending"}; }

# group: SORT DATA
# note: archi-lab_Grimshaw
schedule_sorting_grouping = Custom[Schedule Sorting Grouping](Schedule=views_select_schedule, Parameter_Name=code_block.SortBy, Blank_Line=code_block.out2, Footer_Count=code_block.out3, Footer_Title=code_block.out3, Header=code_block.out2, Sort_Order=code_block.out4)  # This node will allow you to specify sorting/grouping parameters in schedule as well parameters like sorting order, whether its a footer or header. Visit archi-lab.net for more information.

# group: OUTPUT
watch = Watch(schedule_sorting_grouping)

# group: INPUT
file_path_browse_to_project = Filename("G:\76287.00\3.0_Working\3.8_Revit\4_KeynoteList\Fidelity NGIC_ Master Materials List.xlsx")  # "File Path - Browse to project Keynotes Excel File"

# group: INPUT
string_select_excel_worksheet = StringInput("AI Material List")  # "String - Select Excel Worksheet Name"

# group: INPUT
number_select_number_of_header = CodeBlock { 3; }  # "Number - Select number of header rows"

# group: READ DATA FROM THE FIRST TWO COLUMNS OF THE EXCEL FILE
fromPath = FileObject(file_path_browse_to_project)  # "File.FromPath"
boolean = BoolSelector(true)
readFromFile = Excel.ReadFromFile(file=fromPath, sheetName=string_select_excel_worksheet, readAsStrings=boolean)
dropItems = List.DropItems(list=readFromFile, amount=number_select_number_of_header)
code_block_2 = CodeBlock { {0,1}; }
getItemAtIndex = List.GetItemAtIndex(list=dropItems@L2, index=code_block_2)
boolean_2 = BoolSelector(false)
clean = List.Clean(list=getItemAtIndex, preserveIndices=boolean_2)

# group: Organize keynotes in Divisions and Sections
division_prefix_number = CodeBlock()
# ---------- division_prefix_number.designscript (25 lines) ----------
{
"01",
"02",
"03",
"04",
"05",
"06",
"07",
"08",
"09",
"10",
"11",
"12",
"13",
"14",
"21",
"22",
"23",
"25",
"26",
"27",
"28",
"31",
"32"
};
# ----------------------------------------
formatKeynoteList = Python(IN[0]=clean, IN[1]=division_prefix_number)
# ---------- formatKeynoteList.python (39 lines) ----------
#Format keynote list nesting divisions, sections and elements

ExcelInput = UnwrapElement(IN[0])
DivisionPrefix = UnwrapElement(IN[1])
Divisions = []
Sections = []

FormattedKeynotes = []

#Define test for divisions and sections
DivisionNrTest = []
SectionNrTest = []
for x in DivisionPrefix:
	DivisionNrTest.append(x + " 00")
	SectionNrTest.append(x + " ")

#Divide Divisions, Sections and SubNumbers
for row in ExcelInput:
	key = row[0]
	Division = key[:5]
	Section = key[:3]
	
	if Division in DivisionNrTest:
		div = row[1]

	elif Section in SectionNrTest:
		sec = row[1]

	else:
		if len(key) == 5:
			item = [div, sec, key, "\0", row[1]]
			FormattedKeynotes.append(item)

		else:
			item = [div, sec, "\0", key, row[1]]
			FormattedKeynotes.append(item)


OUT = FormattedKeynotes
# ----------------------------------------

formatted_data = Watch(formatKeynoteList)

# group: KEYSCHEDULE FIELDS
code_block_3 = CodeBlock()
# ---------- code_block_3.designscript (6 lines) ----------
{"DIVISION",
"SECTION",
"KEYNOTE PARENT",
"KEYNOTE CHILD",
"DESCRIPTION"
};
# ----------------------------------------

# group: ADD DATA TO SCHEDULE
code_block_4 = CodeBlock { true; }
# note: archi-lab_Grimshaw
key_schedule = Custom[Key Schedule](ViewSchedule=views_select_schedule, Data=formatted_data, Parameter_Names=code_block_3, UpperCase=code_block_4)  # This node will take a key schedule, data and a list of parameters and populate it with infomation from data parameter. Visit www.archi-lab.net for more information on how to prep this node for take off.

# group: OUTPUT
watch_2 = Watch(key_schedule)

# group: FORMATTING
code_block_5 = CodeBlock()
# ---------- code_block_5.designscript (7 lines) ----------
{"Key Name","DIVISION","SECTION","KEYNOTE PARENT",
"KEYNOTE CHILD", "KEYNOTE", "DESCRIPTION"};
{true, true, true, true, true,false,false};
{"Horizontal","Horizontal","Horizontal","Horizontal",
"Horizontal","Horizontal","Horizontal"};
{"Left","Left","Left","Left","Left","Left","Left"};
{1,1,1,1,1,0.8,4};
# ----------------------------------------

# group: FEET2INCHES
code_block_6 = CodeBlock { 12; }
div = code_block_5.out4 / code_block_6

# group: FORMAT SCHEDULE
# note: archi-lab_Grimshaw
schedule_formatting = Custom[Schedule Formatting](Schedule=views_select_schedule, Parameter_Name=code_block_5.out0, Column_Heading=code_block_5.out0, Hidden=code_block_5.out1, Heading_Orientation=code_block_5.out2, Horizontal_Align=code_block_5.out3, Column_Width=div)  # This node will allow you to control schedule formatiing options like column width, whether a column is hidden, column heading etc.

# group: OUTPUT
watch_3 = Watch(schedule_formatting)

# group: TEST IF THERE IS ANY NULL ITEM
transpose = List.Transpose(clean)
code_block_7 = CodeBlock { 0; 1; }
getItemAtIndex_2 = List.GetItemAtIndex(list=transpose, index=code_block_7.out1)
watch_4 = Watch(getItemAtIndex_2)
getItemAtIndex_3 = List.GetItemAtIndex(list=transpose, index=code_block_7.out0)
watch_5 = Watch(getItemAtIndex_3)

# group: CHECK NULL ITEMS
code_block_8 = CodeBlock { null; }
eq = getItemAtIndex_2 == code_block_8
filterByBoolMask = List.FilterByBoolMask(list=getItemAtIndex_3, mask=eq)
watch_6 = Watch(filterByBoolMask.in)
eq_2 = getItemAtIndex_3 == code_block_8
filterByBoolMask_2 = List.FilterByBoolMask(list=getItemAtIndex_3, mask=eq_2)
watch_7 = Watch(filterByBoolMask_2.in)
