# Dynamo graph MarkDoorByRoom.dyn (Dynamo 0.9.2.4472)

# group: input settings
# note: RoomSource: mark door by From Room/To Room
# to: numbered by To Room
# from: numbered by From Room
string = StringInput("from")
# note: LetterRequired: required to have letter as suffix
# True: e.g. 101A, 102A, 102B
# False: e.g. 101, 102A, 102B
boolean = BoolSelector(false)

# group: input doors
# note: Doors: doors to be marked by room
# optional: apply filter to the input door list
categories = Categories("Doors")
all_elements_of_category = ElementsOfCategory(categories)

markDoorByRoom = Custom[MarkDoorByRoom](RoomSource=string, LetterRequired=boolean, Doors=all_elements_of_category)

# group: succeed
# note: DoorsNewMarks: successfully update Door marks
watch = Watch(markDoorByRoom.DoorsNewMarks)
# note: DoorsRemarked: successfully updated Door elements
# optional: click the green ID to view the door in Revit
watch_2 = Watch(markDoorByRoom.DoorsRemarked)

# group: failed
# note: DoorsWithoutSourceRoom: doors without source room
# optional: click the green ID to view the door in Revit
watch_3 = Watch(markDoorByRoom.DoorsWithoutSourceRoom)
# note: DoorsWithoutLocation: doors without location
# optional: click the green ID to view the door in Revit
watch_4 = Watch(markDoorByRoom.DoorsWithoutLocation)
