# Dynamo graph MeasureMultipleLinesLength.dyn (Dynamo 1.3.0.875)

# group: OUTPUT
# note: SCRIPT OUTPUT MIGHT INCLUDE DATA OR SIMPLY NOTIFICATION OF WHETHER THE SCRIPT RAN SUCCESSFULLY. HIGHLIGHTING THE OUTPUT OR FINAL STEP WILL HELP OTHER USERS TO QUICKLY IDENTIFY WHERE TO LOOK FOR RESULTS
# note: SCRIPT OUTPUT

# group: PROCESS
# note: DYNAMO PROCESS ORGANIZED AND GROUPED IN STEPS SO THAT OTHER USERS CAN UNDERSTAND THE LOGIC OF THE SCRIPT IN ORDER TO CUSTOMIZE THE SCRIPT OR REUSE PORTION OF THE LOGIC TO IMPLEMENT NEW WORKFLOWS
# note: PROCESS DATA

# group: INPUT
# note: SCRIPT INPUT REQUIRED TO RUN THE SCRIPT. THESE INCLUDE INPUTS THAT ARE LESS LIKEY TO CHANGE FOR OTHER USERS TO IMPLEMENT THE SCRIPT ON THEIR PROJECT
# note: SECONDARY INPUT (OPTIONAL)

# group: INPUT
# note: PRIMARY INPUT REQUIRED TO RUN THE SCRIPT. THESE INCLUDES INPUTS THAT OTHER USERS NEED TO PROVIDE IN ORDER TO ADAPT THE WORKFLOW TO THEIR PROJECTS
# note: PRIMARY INPUT

# group: GENERAL
# note: CUSTOM NODE: MeasureMultipleLinesLength
# DESCRIPTION: Display in a message box the total length of selected lines
# REVIT VERSION 2017
# DYNAMO 1.3.0
# DEPENDENT PACKAGES: CLOCKWORK, SPRING NODES
# AUTHOR: Ilaria Giardiello
# DATETIME: 11/27/2017
# REFERENCE: N/A

# group: INPUT
select_curves_to_measure = DSModelElementsSelection()  # "Select curves to measure - SelectCurves"; 4 picked in the model
code_block_roundingprecision = CodeBlock { 1/64; }

# group: SASAKI PACKAGE MeasureMultipleLinesLength
measureMultipleLinesLength = Custom[MeasureMultipleLinesLength](SelectedCurves=select_curves_to_measure, RoundingPrecision=code_block_roundingprecision)  # Display in a message box the total length of selected lines.

# group: Measured Length
watch = Watch(measureMultipleLinesLength)
