# Dynamo graph NumberRoomByGrid.dyn (Dynamo 1.2.1.3083)

# group: GridPrefix
# note: Prefix: grid name prefix
# default value: ""
# optional: have a special grid for room numbering, e.g. prefix by _
code_block = CodeBlock { ""; }

# group: Rooms
# note: Rooms: rooms to be updated
# optional: apply filter to the input room list
categories = Categories("Rooms")
all_elements_of_category = ElementsOfCategory(categories)

# group: LevelNumbers & LevelNames
code_block_2 = CodeBlock()
# ---------- code_block_2.designscript (3 lines) ----------
{"1",
 "2",
 "3"};
# ----------------------------------------
# note: LevelNames: all level names
# LevelNumbers: the shortname to present the level name in the room number
code_block_3 = CodeBlock()
# ---------- code_block_3.designscript (3 lines) ----------
{"Level 1",
 "Level 2",
 "Level 3"};
# ----------------------------------------

# group: GridOrder
# note: GridOrder: {string}
# vh: vertical grid firstly, then horizontal grid
# hv: horizontal grid firstly, then vertical grid
string = StringInput("vh")

# group: LevelGridSeparator & GridXYSeparator
# note: LevelGridSeparator: separator between LevelNumber and GridNames
# GridXYSeparator: separator between vertical and horizontal grids
code_block_4 = CodeBlock { "-"; ""; }

numberRoomByGrid = Custom[NumberRoomByGrid](GridPrefix=code_block, Rooms=all_elements_of_category, LevelNumbers=code_block_2, LevelNames=code_block_3, GridOrder=string, LevelGridSeparator=code_block_4.out0, GridXYSeparator=code_block_4.out1)  # update room number by grid crosspoint

# group: rooms without location
# note: RoomsWithoutLocation: room(s) without location information, e.g. doesn't delete from the room schedule
# optional: click the green ID to view the room in Revit
watch = Watch(numberRoomByGrid.RoomsWithoutLocation)

# group: room numbers
# note: RoomNumbers: successfully set room numbers
watch_2 = Watch(numberRoomByGrid.RoomNumbers)
