# Dynamo graph PlaceScheduleOnSheet.dyn (Dynamo 1.2.1.3083)

# group: get Sheet by name
# note: RevitSheet: sheet to place schedule
categories = Categories("Sheets")
all_elements_of_category = ElementsOfCategory(categories)
name = Element.Name(all_elements_of_category)
string = StringInput("Sheet1")
eq = name == string
filterByBoolMask = List.FilterByBoolMask(list=all_elements_of_category, mask=eq)
code_block = CodeBlock(x=filterByBoolMask.in) { x[0]; }

# group: get Schedule by name
# note: RevitSchedule: schedule to be placed on sheet
element_types = ElementTypes("ViewSchedule")
all_elements_of_type = ElementsOfType(element_types)
name_2 = Element.Name(all_elements_of_type)
string_2 = StringInput("DOOR SCHEDULE")
eq_2 = name_2 == string_2
filterByBoolMask_2 = List.FilterByBoolMask(list=all_elements_of_type, mask=eq_2)
code_block_2 = CodeBlock(x=filterByBoolMask_2.in) { x[0]; }

# group: location point
# note: Location: coordinate of the Scheduleschedule's lower left corner on the sheet
code_block_3 = CodeBlock { 0.15; 2.4; 0; }
byCoordinates = Point.ByCoordinates(x=code_block_3.out0, y=code_block_3.out1, z=code_block_3.out2)

placeScheduleOnSheet = Custom[PlaceScheduleOnSheet](RevitSheet=code_block, RevitSchedule=code_block_2, ScheduleLocation=byCoordinates)  # Place schedule on sheet

# group: complete status
# note: Status: succeed/failed
watch = Watch(placeScheduleOnSheet)
