# Dynamo graph RenumberViewports.dyn (Dynamo 1.2.1.3083)

# group: sheet number
# note: SheetNumber: sheet to be worked on, type in sheet number same as shown on the sheet
string = StringInput("A7-14")

# group: sort order
# note: SortOrder: either x or y as sort order
# x: sort view numebrs vertically (sasaki standard)
# y: sort view number horizontally (works better on elevation sheets)
string_2 = StringInput("x")

# group: title block margins
# note: Margins: right, left, top, bottom margins of title block, measured in feet.
# Sasaki Standard Title Block Margins are:
# Right: 0.36
# Left: 0.13
# Top: 0.04
# Bottom: 0.04
code_block = CodeBlock { 0.36; 0.13; 0.04; 0.04; }

renumberViewports = Custom[RenumberViewports](SheetNumber=string, SortOrder=string_2, Right_Margin=code_block.out0, Left_Margin=code_block.out1, Top_Margin=code_block.out2, Bottom_Margin=code_block.out3)  # Renumber Viewports on a Sheet
watch = Watch(renumberViewports.Viewport_Order)
watch_2 = Watch(renumberViewports.Succeed)
