# Dynamo graph RevisionCloudSheets.dyn (Dynamo 1.3.0.875)

# group: OUTPUT
# note: SCRIPT OUTPUT MIGHT INCLUDE DATA OR SIMPLY NOTIFICATION OF WHETHER THE SCRIPT RAN SUCCESSFULLY. HIGHLIGHTING THE OUTPUT OR FINAL STEP WILL HELP OTHER USERS TO QUICKLY IDENTIFY WHERE TO LOOK FOR RESULTS
# note: SCRIPT OUTPUT

# group: PROCESS
# note: DYNAMO PROCESS ORGANIZED AND GROUPED IN STEPS SO THAT OTHER USERS CAN UNDERSTAND THE LOGIC OF THE SCRIPT IN ORDER TO CUSTOMIZE THE SCRIPT OR REUSE PORTION OF THE LOGIC TO IMPLEMENT NEW WORKFLOWS
# note: PROCESS DATA

# group: INPUT
# note: SCRIPT INPUT REQUIRED TO RUN THE SCRIPT. THESE INCLUDE INPUTS THAT ARE LESS LIKEY TO CHANGE FOR OTHER USERS TO IMPLEMENT THE SCRIPT ON THEIR PROJECT
# note: SECONDARY INPUT (OPTIONAL)

# group: INPUT
# note: PRIMARY INPUT REQUIRED TO RUN THE SCRIPT. THESE INCLUDES INPUTS THAT OTHER USERS NEED TO PROVIDE IN ORDER TO ADAPT THE WORKFLOW TO THEIR PROJECTS
# note: PRIMARY INPUT

# group: GENERAL
# note: CUSTOM NODE: RevisionSheetsList
# DESCRIPTION: Identify all sheets containing revision clouds for the selected revision.
# REVIT VERSION 2017
# DYNAMO 1.3.0
# DEPENDENT PACKAGES: CLOCKWORK
# AUTHOR: Gloriana Gonzales
# DATETIME: 05/22/2017
# LAST UPDATE: Ilaria Giardiello
# DATETIME: 02/08/2017
# REFERENCE: N/A

# group: INPUT
string_revisionname = StringInput("BULLETIN-05")

# group: SASAKI CUSTOM PACKAGE: RevisionCloudSheets
revisionCloudSheets = Custom[RevisionCloudSheets](RevisionNumber=string_revisionname)  # Identify all sheets containing revision clouds for the selected revision

# group: REVISION SHEETS NR
watch = Watch(revisionCloudSheets.SheetsContaingClouds_Nr)

# group: REVISION VIEWS
watch_2 = Watch(revisionCloudSheets.ViewsContaingClouds)

# group: REVISION SHEETS NAMES
watch_3 = Watch(revisionCloudSheets.SheetsContaingClouds_Name)
