# Dynamo graph SearchforNodePackage.dyn (Dynamo 1.3.0.875)

# group: OUTPUT
# note: SCRIPT OUTPUT MIGHT INCLUDE DATA OR SIMPLY NOTIFICATION OF WHETHER THE SCRIPT RAN SUCCESSFULLY. HIGHLIGHTING THE OUTPUT OR FINAL STEP WILL HELP OTHER USERS TO QUICKLY IDENTIFY WHERE TO LOOK FOR RESULTS
# note: SCRIPT OUTPUT

# group: PROCESS
# note: DYNAMO PROCESS ORGANIZED AND GROUPED IN STEPS SO THAT OTHER USERS CAN UNDERSTAND THE LOGIC OF THE SCRIPT IN ORDER TO CUSTOMIZE THE SCRIPT OR REUSE PORTION OF THE LOGIC TO IMPLEMENT NEW WORKFLOWS
# note: PROCESS DATA

# group: INPUT
# note: SECONDARY INPUT (OPTIONAL)
# note: SCRIPT INPUT REQUIRED TO RUN THE SCRIPT. THESE INCLUDE INPUTS THAT ARE LESS LIKEY TO CHANGE FOR OTHER USERS TO IMPLEMENT THE SCRIPT ON THEIR PROJECT

# group: INPUT
# note: PRIMARY INPUT
# note: PRIMARY INPUT REQUIRED TO RUN THE SCRIPT. THESE INCLUDES INPUTS THAT OTHER USERS NEED TO PROVIDE IN ORDER TO ADAPT THE WORKFLOW TO THEIR PROJECTS

# group: GENERAL
# note: DESCRIPTION: Small script using an existing package that helps to find to which package a node belongs when you cannot find it.
# REVIT VERSION 2017
# DYNAMO 1.3.0
# DEPENDENT PACKAGES: WHATTHENODE
# AUTHOR: Ilaria Giardiello
# DATETIME: 01/30/2017
# REFERENCE: N/A

# group: INPUT
string_name_of_the_node_you_are = StringInput("View.ApplyViewTemplate")  # "String - Name of the Node you are looking for"

# group: FIND THE NODE
# note: WhatTheNode
whatTheNode = Custom[WhatTheNode](nodeInQuestion=string_name_of_the_node_you_are)  # This is a duplicate of a node from Rhythm to help figure out what package custom nodes are from. It utilizes dynamonodes.com's database.

# group: PACKAGE
watch = Watch(whatTheNode.likelyPackage)
