# Dynamo graph UpperCaseViewsOnSheet.dyn (Dynamo 1.3.0.875)

# group: OUTPUT
# note: SCRIPT OUTPUT MIGHT INCLUDE DATA OR SIMPLY NOTIFICATION OF WHETHER THE SCRIPT RAN SUCCESSFULLY. HIGHLIGHTING THE OUTPUT OR FINAL STEP WILL HELP OTHER USERS TO QUICKLY IDENTIFY WHERE TO LOOK FOR RESULTS
# note: SCRIPT OUTPUT

# group: PROCESS
# note: DYNAMO PROCESS ORGANIZED AND GROUPED IN STEPS SO THAT OTHER USERS CAN UNDERSTAND THE LOGIC OF THE SCRIPT IN ORDER TO CUSTOMIZE THE SCRIPT OR REUSE PORTION OF THE LOGIC TO IMPLEMENT NEW WORKFLOWS
# note: PROCESS DATA

# group: INPUT
# note: SCRIPT INPUT REQUIRED TO RUN THE SCRIPT. THESE INCLUDE INPUTS THAT ARE LESS LIKEY TO CHANGE FOR OTHER USERS TO IMPLEMENT THE SCRIPT ON THEIR PROJECT
# note: SECONDARY INPUT (OPTIONAL)

# group: INPUT
# note: PRIMARY INPUT REQUIRED TO RUN THE SCRIPT. THESE INCLUDES INPUTS THAT OTHER USERS NEED TO PROVIDE IN ORDER TO ADAPT THE WORKFLOW TO THEIR PROJECTS
# note: PRIMARY INPUT

# group: GENERAL
# note: CUSTOM NODE: UpperCaseViewsOnSheets
# DESCRIPTION: Automatically convert to uppercase all view names for views placed on sheets
# REVIT VERSION 2017
# DYNAMO 1.3.0
# DEPENDENT PACKAGES: SPRING NODES
# AUTHOR: Ilaria Giardiello
# DATETIME: 11/28/2017
# REFERENCE: N/A

# group: SASAKI PACKAGE Sheet Views Uppercase
upperCaseViewsOnSheets = Custom[UpperCaseViewsOnSheets]()  # Automatically convert to uppercase all view names for views placed on sheets

# group: ORIGINAL VIEW NAMES
watch = Watch(upperCaseViewsOnSheets.OriginalViewNames)

# group: UPDATED VIEW NAMES
watch_2 = Watch(upperCaseViewsOnSheets.UpdatedViewNames)
